# Grasshopper definition Iterator2Testing.gh (Grasshopper 0.9.76)
# plug-ins: Colibri

listdd = ValueList({"One": 1, "Two": 2, "Three": 2² - 1, "Four": Sqrt(16)}, selected="One")
wwr = Slider(0.484, range=0..1)
ddd = Slider(10, range=0..10)
list = Panel("dddg")
number_slider = Slider(0.25, range=0..1)
iterator = Iterator2(Inputs=Toggle(False), Fly=Toggle(True))
panel = Panel(iterator)
