# Grasshopper definition Workflow Sketch.gh (Grasshopper 0.9.76)
# plug-ins: DesignExplorerGrasshopper

merge = Merge(Data1=Slider(0.397, range=0..1), Data2=Slider(0.25, range=0..1))
panel = Panel("""15
10""")
dummy = Dummy(Hello=Slider(0.397, range=0..1), World=Slider(0.25, range=0..1))

# ---- group: ITERATOR
c_script = CSharpScript(Sliders=merge, Steps=panel, Run=Button())  # -> Out, Inputs

# ----
c_script_2 = CSharpScript(X=merge, Y=panel)  # -> Out, A
panel_2 = Panel(dummy)

# ---- group: Image Parameters
c_script_3 = CSharpScript()

# ---- group: Aggregator
c_script_4 = CSharpScript(
    Directory="C:\Users\bhowes\Desktop\Dummy",
    Inputs=c_script.Inputs,
    Outputs=c_script_2.A,
    ImageParams=c_script_3,
    WriteFile=Toggle(False))  # -> Out, A
